# Grasshopper definition Ettv_BcaValidationCaseStudy.gh (Grasshopper 1.0.8)
# plug-ins: FacadeFlux Info

fluxmaterial = FluxMaterial()
panel = Panel()
panel_2 = Panel()
merge = Merge(Data1=fluxmaterial)
brep = Brep(<brep referenced from the Rhino model>)
brep_2 = Brep(<brep referenced from the Rhino model>)
brep_3 = Brep([<brep referenced from the Rhino model> x23])
brep_4 = Brep([<brep referenced from the Rhino model> x23])
brep_5 = Brep([<brep referenced from the Rhino model> x23])
fluxfenestrationconstruction = FluxFenestrationConstruction(Id=panel, Name=panel_2, Materials=merge)
deconstruct_brep = DeconstructBrep(Brep=brep)  # -> flatten(Faces), Edges, Vertices
deconstruct_brep_2 = DeconstructBrep(Brep=brep_2)  # -> flatten(Faces), Edges, Vertices
deconstruct_brep_3 = DeconstructBrep(Brep=brep_3)  # -> flatten(Faces), Edges, Vertices
deconstruct_brep_4 = DeconstructBrep(Brep=brep_4)  # -> flatten(Faces), Edges, Vertices
deconstruct_brep_5 = DeconstructBrep(Brep=brep_5)  # -> flatten(Faces), Edges, Vertices

fluxmaterialdatabase = FluxMaterialDatabase(SelectedMaterial="Glass, sheet")  # -> MaterialName, KValue
fluxmaterialdatabase_2 = FluxMaterialDatabase(SelectedMaterial="Air gap")  # -> MaterialName, KValue
fluxmaterialdatabase_3 = FluxMaterialDatabase(SelectedMaterial="Glass, sheet")  # -> MaterialName, KValue
fluxmaterial_2 = FluxMaterial(Name=fluxmaterialdatabase_2.MaterialName, Conductivity=fluxmaterialdatabase_2.KValue, Thickness="100")
fluxmaterial_3 = FluxMaterial(Name=fluxmaterialdatabase.MaterialName, Conductivity=fluxmaterialdatabase.KValue, Thickness="6")
fluxmaterial_4 = FluxMaterial(Name=fluxmaterialdatabase_3.MaterialName, Conductivity=fluxmaterialdatabase_3.KValue, Thickness="8")
merge_2 = Merge(Data1=fluxmaterial_4, Data2=fluxmaterial_2, Data3=fluxmaterial_3)
fluxfenestrationconstruction_2 = FluxFenestrationConstruction(Id="F2", Name="Double Glazing", Materials=merge_2, Sc="0.47")

fluxmaterial_5 = FluxMaterial(Name="RC Concrete", Conductivity="1.442", Thickness="250")
fluxmaterial_6 = FluxMaterial(Name="Cement Plaster", Conductivity="0.533", Thickness="12")
fluxmaterial_7 = FluxMaterial(Name="Marble Tile", Conductivity="1.298", Thickness="12")
merge_3 = Merge(Data1=fluxmaterial_7, Data2=fluxmaterial_5, Data3=fluxmaterial_6)
fluxopaqueconstruction = FluxOpaqueConstruction(Id="W1", Name="250mm RC Beam", Materials=merge_3)

fluxmaterial_8 = FluxMaterial(Name="RC Concrete", Conductivity="1.442", Thickness="200")
fluxmaterial_9 = FluxMaterial(Name="Cement Plaster", Conductivity="0.533", Thickness="12")
fluxmaterial_10 = FluxMaterial(Name="Marble Tile", Conductivity="1.298", Thickness="12")
merge_4 = Merge(Data1=fluxmaterial_10, Data2=fluxmaterial_8, Data3=fluxmaterial_9)
fluxopaqueconstruction_2 = FluxOpaqueConstruction(Id="W2", Name="200mm r.c beam", Materials=merge_4)

fluxmaterialdatabase_4 = FluxMaterialDatabase(SelectedMaterial="Glass, sheet")  # -> MaterialName, KValue
fluxmaterial_11 = FluxMaterial(Name=fluxmaterialdatabase_4.MaterialName, Conductivity=fluxmaterialdatabase_4.KValue, Thickness="8")
fluxfenestrationconstruction_3 = FluxFenestrationConstruction(Id="F1", Name="8mm Single Glazing", Materials=fluxmaterial_11, Sc="0.61")

fluxmaterialdatabase_5 = FluxMaterialDatabase(SelectedMaterial="Air gap")  # -> MaterialName, KValue
fluxmaterialdatabase_6 = FluxMaterialDatabase(SelectedMaterial="Glass, sheet")  # -> MaterialName, KValue
fluxmaterialdatabase_7 = FluxMaterialDatabase(SelectedMaterial="Concrete")  # -> MaterialName, KValue
fluxmaterial_12 = FluxMaterial(Name=fluxmaterialdatabase_5.MaterialName, Conductivity=fluxmaterialdatabase_5.KValue, Thickness="100")
fluxmaterial_13 = FluxMaterial(Name=fluxmaterialdatabase_7.MaterialName, Conductivity=fluxmaterialdatabase_7.KValue, Thickness="250")
fluxmaterial_14 = FluxMaterial(Name=fluxmaterialdatabase_6.MaterialName, Conductivity=fluxmaterialdatabase_6.KValue, Thickness="8")
merge_5 = Merge(Data1=fluxmaterial_14, Data2=fluxmaterial_12, Data3=fluxmaterial_13)
fluxopaqueconstruction_3 = FluxOpaqueConstruction(Id="W3", Name="250mm r.c beam with glass cladding", Materials=merge_5)

fluxmaterialdatabase_8 = FluxMaterialDatabase(SelectedMaterial="Air gap")  # -> MaterialName, KValue
fluxmaterialdatabase_9 = FluxMaterialDatabase(SelectedMaterial="Glass, sheet")  # -> MaterialName, KValue
fluxmaterialdatabase_10 = FluxMaterialDatabase(SelectedMaterial="Plaster: sand/cement")  # -> MaterialName, KValue
fluxmaterialdatabase_11 = FluxMaterialDatabase(SelectedMaterial="Plaster: sand/cement")  # -> MaterialName, KValue
fluxmaterialdatabase_12 = FluxMaterialDatabase(SelectedMaterial="Brick (dry, covered by plaster/tiles)")  # -> MaterialName, KValue
fluxmaterial_15 = FluxMaterial(Name=fluxmaterialdatabase_8.MaterialName, Conductivity=fluxmaterialdatabase_8.KValue, Thickness="100")
fluxmaterial_16 = FluxMaterial(Name=fluxmaterialdatabase_10.MaterialName, Conductivity=fluxmaterialdatabase_10.KValue, Thickness="12")
fluxmaterial_17 = FluxMaterial(Name=fluxmaterialdatabase_9.MaterialName, Conductivity=fluxmaterialdatabase_9.KValue, Thickness="8")
fluxmaterial_18 = FluxMaterial(Name=fluxmaterialdatabase_11.MaterialName, Conductivity=fluxmaterialdatabase_11.KValue, Thickness="12")
fluxmaterial_19 = FluxMaterial(Name=fluxmaterialdatabase_12.MaterialName, Conductivity=fluxmaterialdatabase_12.KValue, Thickness="115")
merge_6 = Merge(Data1=fluxmaterial_17, Data2=fluxmaterial_15, Data3=fluxmaterial_16, Data4=fluxmaterial_19, Data5=fluxmaterial_18)
fluxopaqueconstruction_4 = FluxOpaqueConstruction(Id="W4", Name="115mm brick parapet with glass cladding", Materials=merge_6)

data = Data(fluxopaqueconstruction)
data_2 = Data(fluxfenestrationconstruction_3)
data_3 = Data(fluxopaqueconstruction_2)
data_4 = Data(fluxfenestrationconstruction_2)
data_5 = Data(fluxopaqueconstruction_3)
data_6 = Data(fluxopaqueconstruction_4)
deconstruct_fluxconstruction = DeconstructFluxConstruction(FluxConstruction=data_5)  # -> Summary, Uvalue, ScTotal, Materials, ConstructionName, ConstructionId, ConstructionName_2, ConstructionId_2

brep_6 = Brep([<brep referenced from the Rhino model> x2])
brep_7 = Brep([<brep referenced from the Rhino model> x2])
brep_8 = Brep([<brep referenced from the Rhino model> x2])
deconstruct_brep_6 = DeconstructBrep(Brep=brep_6)  # -> flatten(Faces), Edges, Vertices
deconstruct_brep_7 = DeconstructBrep(Brep=brep_7)  # -> flatten(Faces), Edges, Vertices
deconstruct_brep_8 = DeconstructBrep(Brep=brep_8)  # -> flatten(Faces), Edges, Vertices
fluxsurface = FluxSurface(Geometry=deconstruct_brep_8.Faces)
fluxsurface_2 = FluxSurface(Geometry=deconstruct_brep_7.Faces, FluxConstruction=data_3)
fluxsurface_3 = FluxSurface(Geometry=deconstruct_brep_6.Faces)

fluxsurface_4 = FluxSurface(Geometry=deconstruct_brep_5.Faces, FluxConstruction=data_6)
fluxsurface_5 = FluxSurface(Geometry=deconstruct_brep_3.Faces, FluxConstruction=data_4)
fluxsurface_6 = FluxSurface(Geometry=deconstruct_brep_2.Faces, FluxConstruction=data)
fluxsurface_7 = FluxSurface(Geometry=deconstruct_brep.Faces, FluxConstruction=data_2)
fluxsurface_8 = FluxSurface(Geometry=deconstruct_brep_4.Faces, FluxConstruction=data_5)
fluxsc2generator = FluxSc2Generator(FluxSurface=fluxsurface_7, ShadingProjection="3.6", GlazingHeight="3.6")
deconstruct_fluxsurface = DeconstructFluxSurface(FluxSurfaces=fluxsc2generator)  # -> Text, Geometries, Areas, Orientations, FluxConstructions
deconstruct_fluxconstruction_2 = DeconstructFluxConstruction(FluxConstruction=deconstruct_fluxsurface.FluxConstructions)  # -> Summary, Uvalue, ScTotal, Sc1, Sc2, Materials, ConstructionName, ConstructionId
deconstruct_fluxsurface_2 = DeconstructFluxSurface(FluxSurfaces=fluxsc2generator)  # -> Text, Geometries, Areas, Orientations, FluxConstructions
panel_3 = Panel(deconstruct_fluxconstruction_2.Sc2)
deconstruct_fluxconstruction_3 = DeconstructFluxConstruction(FluxConstruction=deconstruct_fluxsurface_2.FluxConstructions)  # -> Summary, Uvalue, ScTotal, Materials, ConstructionName, ConstructionId, ConstructionName_2, ConstructionId_2
merge_7 = Merge(
    Data1=fluxsc2generator,
    Data2=fluxsurface_6,
    Data3=fluxsurface_2,
    Data4=fluxsurface_3,
    Data5=fluxsurface,
    Data6=fluxsurface_4,
    Data7=fluxsurface_5,
    Data8=fluxsurface_8)
list_item = ListItem(List=deconstruct_fluxconstruction_3.Summary, Index=0, Wrap=True)
panel_4 = Panel(list_item)
fluxmodel = FluxModel(ProjectName="BCA_CaseStudy1", FluxSurfaces=merge_7, AngleToNorth="0")  # -> Status, FluxModel

# ---- group: Area Investigation
deconstruct_fluxmodel = DeconstructFluxModel(FluxModel=fluxmodel.FluxModel)  # -> Text, ProjectName, Version, FluxSurfaces
deconstruct_fluxsurface_3 = DeconstructFluxSurface(FluxSurfaces=deconstruct_fluxmodel.FluxSurfaces)  # -> Text, Geometries, Areas, Orientations, FluxConstructions
match_text = MatchText(Text=deconstruct_fluxsurface_3.Orientations, Pattern="East", Case=True)
cull_pattern = CullPattern(List=deconstruct_fluxmodel.FluxSurfaces, CullPattern=match_text)
deconstruct_fluxsurface_4 = DeconstructFluxSurface(FluxSurfaces=cull_pattern)  # -> Text, Geometries, Areas, Orientations, FluxConstructions
deconstruct_fluxconstruction_4 = DeconstructFluxConstruction(FluxConstruction=deconstruct_fluxsurface_4.FluxConstructions)  # -> Summary, Uvalue, ScTotal, Materials, ConstructionName, ConstructionId, ConstructionName_2, ConstructionId_2
match_text_2 = MatchText(Text=deconstruct_fluxconstruction_4.ConstructionId, Pattern="W4", Case=True)
cull_pattern_2 = CullPattern(List=deconstruct_fluxsurface_4.Areas, CullPattern=match_text_2)
mass_addition = MassAddition(Input=cull_pattern_2)  # -> Result, PartialResults
panel_5 = Panel(mass_addition.Result)

# ----
boolean_toggle = BooleanToggle(True)
computefluxmodel = ComputeFluxModel(FluxModel=fluxmodel.FluxModel, RunComputation=boolean_toggle, ComputationType="0")  # -> Summary, ThermalTransferValue, FluxModelResult
display_fluxconstruction_names = DisplayFluxConstructionNames(FluxModel=fluxmodel.FluxModel)  # -> Meshes, Colors, ConstructionName, LegendTitle
display_fluxconstruction_type = DisplayFluxConstructionType(FluxModel=fluxmodel.FluxModel)  # -> Meshes, Colors, ConstructionType, LegendTitle
display_fluxconstruction_u_value = DisplayFluxConstructionUValue(FluxModel=fluxmodel.FluxModel)  # -> Meshes, Colors, Uvalue, LegendTitle
exportfluxhtml = ExportFluxHtml(Result=computefluxmodel.FluxModelResult, RunExport=boolean_toggle)  # -> HtmlPath, HtmlDocument, FileDirectory
fluxlegend = FluxLegend(
    Colors=display_fluxconstruction_u_value.Colors,
    Legend=display_fluxconstruction_u_value.Uvalue,
    LegendTitle=display_fluxconstruction_u_value.LegendTitle)
fluxopenreport = FluxOpenReport(HtmlPath=exportfluxhtml.HtmlPath, ViewReport=Button())
