# Grasshopper definition SchoolBuilding.gh (Grasshopper 1.0.8)
# plug-ins: FacadeFlux Info

rectangle = Rectangle(Plane=PlaneXY(0, 0, 0), XSize=Domain(-1, 1), YSize=Domain(-2, 2), Radius=0)  # -> Rectangle, Length
panel = Panel("""0
1
2""")
explode = Explode(Curve=rectangle.Rectangle, Recursive=True)  # -> Segments, Vertices
number_slider = Slider(0.95, range=0..5)
list_item = ListItem(List=explode.Segments, Index=panel, Wrap=True)
negative = Negative(Value=number_slider)
join_curves = JoinCurves(Curves=list_item, Preserve=False)
curve = Curve(rectangle.Rectangle)
offset_curve = OffsetCurve(Curve=join_curves, Distance=[number_slider, negative], Corners=1)
evaluate_curve = EvaluateCurve(Curve=reparameterize(offset_curve), Parameter="1")  # -> Point, Tangent, Angle
evaluate_curve_2 = EvaluateCurve(Curve=reparameterize(offset_curve), Parameter="0")  # -> Point, Tangent, Angle
explode_tree = ExplodeTree(Data=evaluate_curve.Point)  # -> _0000, _0001
explode_tree_2 = ExplodeTree(Data=evaluate_curve_2.Point)  # -> _0000, _0001
line = Line(StartPoint=explode_tree._0000, EndPoint=explode_tree._0001)
line_2 = Line(StartPoint=explode_tree_2._0000, EndPoint=explode_tree_2._0001)
merge = Merge(Data1=flatten(offset_curve), Data2=flatten(line_2), Data3=flatten(line))
join_curves_2 = JoinCurves(Curves=merge, Preserve=False)
scale = Scale(Geometry=join_curves_2, Center=Point(0, 0, 0), Factor=Slider(10, range=0..10))  # -> Geometry, Transform
unit_z = UnitZ(Factor=Slider(5, range=0..10))
extrude = Extrude(Base=scale.Geometry, Direction=unit_z)
linear_array = LinearArray(Geometry=extrude, Direction=unit_z, Count=Slider(4, range=0..10))  # -> Geometry, Transform
deconstruct_brep = DeconstructBrep(Brep=linear_array.Geometry)  # -> Faces, Edges, Vertices
negative_2 = Negative(Value=Slider(2, range=0..2))
face_boundaries = FaceBoundaries(Mesh=deconstruct_brep.Faces)  # -> flatten(Boundaries)
offset_curve_2 = OffsetCurve(Curve=face_boundaries, Distance=negative_2, Corners=1)
boundary_surfaces = BoundarySurfaces(Edges=offset_curve_2)  # -> flatten(Surfaces)
solid_difference = SolidDifference(BrepsA=flatten(deconstruct_brep.Faces), BrepsB=flatten(boundary_surfaces))
area = Area(Geometry=[solid_difference, boundary_surfaces])  # -> Area, Centroid
mass_addition = MassAddition(Input=area.Area)  # -> Result, PartialResults

number_slider_2 = Slider(5, range=0..10)
unit_z_2 = UnitZ(Factor=number_slider_2)
rectangle_2 = Rectangle(Plane=PlaneXY(0, 0, 0), XSize=number_slider_2, YSize=number_slider_2, Radius=0)  # -> Rectangle, Length
extrude_2 = Extrude(Base=rectangle_2.Rectangle, Direction=unit_z_2)
deconstruct_brep_2 = DeconstructBrep(Brep=extrude_2)  # -> Faces, Edges, Vertices
area_2 = Area(Geometry=deconstruct_brep_2.Faces)  # -> Area, Centroid
scale_2 = Scale(Geometry=deconstruct_brep_2.Faces, Center=area_2.Centroid, Factor=Slider(0.5, range=0..1))  # -> Geometry, Transform
solid_difference_2 = SolidDifference(BrepsA=flatten(deconstruct_brep_2.Faces), BrepsB=flatten(scale_2.Geometry))
brep_wireframe = BrepWireframe(Brep=[scale_2.Geometry, solid_difference_2], Density=-1)

fluxmaterialdatabase = FluxMaterialDatabase(SelectedMaterial="Glass, sheet")  # -> MaterialName, KValue
fluxmaterialdatabase_2 = FluxMaterialDatabase(SelectedMaterial="Oxygen gas")  # -> MaterialName, KValue
fluxmaterialdatabase_3 = FluxMaterialDatabase(SelectedMaterial="Aluminium alloy, typical")  # -> MaterialName, KValue
area_3 = Area(Geometry=scale_2.Geometry)  # -> Area, Centroid
brep_wireframe_2 = BrepWireframe(Brep=[solid_difference, boundary_surfaces], Density=-1)
boolean_toggle = BooleanToggle(True)

ettvmaterialdatabase = EttvMaterialDatabase(SelectedMaterial="Glass wool, mat or quilt (dry)")  # -> MaterialName, KValue
ettvmaterialdatabase_2 = EttvMaterialDatabase(SelectedMaterial="Oxygen gas")  # -> MaterialName, KValue
ettvmaterialdatabase_3 = EttvMaterialDatabase(SelectedMaterial="Concrete, lightweight (density 1280 kg/m³)")  # -> MaterialName, KValue

fluxmaterial = FluxMaterial(Name=ettvmaterialdatabase.MaterialName, Conductivity=ettvmaterialdatabase.KValue, Thickness="120")
fluxmaterial_2 = FluxMaterial(Name=fluxmaterialdatabase_3.MaterialName, Conductivity=fluxmaterialdatabase_3.KValue, Thickness="1.5")
fluxmaterial_3 = FluxMaterial(Name=ettvmaterialdatabase_3.MaterialName, Conductivity=ettvmaterialdatabase_3.KValue, Thickness="110")
fluxmaterial_4 = FluxMaterial(Name=ettvmaterialdatabase_2.MaterialName, Conductivity=ettvmaterialdatabase_2.KValue, Thickness="75")

merge_2 = Merge(Data1=fluxmaterial_2, Data2=fluxmaterial, Data3=fluxmaterial_2, Data4=fluxmaterial_4, Data5=fluxmaterial_3)

fluxopaqueconstruction = FluxOpaqueConstruction(Id="W1", Name="ACP + Lightweight Concrete", Materials=merge_2)
deconstruct_fluxmaterial = DeconstructFluxMaterial(FluxMaterial=merge_2)  # -> Summary, Name, Thickness, ThermalConductivity
deconstruct_fluxconstruction = DeconstructFluxConstruction(FluxConstruction=fluxopaqueconstruction)  # -> Summary, Uvalue, ScTotal, Materials
panel_2 = Panel(deconstruct_fluxconstruction.Summary)
deconstruct_fluxmaterial_2 = DeconstructFluxMaterial(FluxMaterial=deconstruct_fluxconstruction.Materials)  # -> Summary, Name, Thickness, ThermalConductivity
panel_3 = Panel(deconstruct_fluxmaterial_2.Summary)
ettvsurfacecomponent = EttvSurfaceComponent(Geometry=solid_difference, EttvConstruction=fluxopaqueconstruction)  # -> flatten(EttvSurfaces)
deconstruct_fluxsurface = DeconstructFluxSurface(FluxSurfaces=ettvsurfacecomponent)  # -> Text, Geometries, Areas, Orientations, FluxConstructions
deconstruct_fluxconstruction_2 = DeconstructFluxConstruction(FluxConstruction=deconstruct_fluxsurface.FluxConstructions)  # -> Summary, Uvalue, ScTotal, Materials
panel_4 = Panel(deconstruct_fluxconstruction_2.Summary)
fluxmaterial_5 = FluxMaterial(Name=fluxmaterialdatabase.MaterialName, Conductivity=fluxmaterialdatabase.KValue, Thickness="6")
fluxmaterial_6 = FluxMaterial(Name=fluxmaterialdatabase_2.MaterialName, Conductivity=fluxmaterialdatabase_2.KValue, Thickness="13")

merge_3 = Merge(Data1=fluxmaterial_5, Data2=fluxmaterial_6, Data3=fluxmaterial_5)
fluxfenestrationconstruction = FluxFenestrationConstruction(Id="F1", Name="Double Glazing", Materials=merge_3, Sc="0.43")

deconstructettvconstruction = DeconstructEttvConstruction(EttvConstruction=fluxfenestrationconstruction)  # -> Text, Uvalue, ScValue, Materials
panel_5 = Panel(deconstructettvconstruction.Text)
fluxsurface = FluxSurface(Geometry=boundary_surfaces, FluxConstruction=fluxfenestrationconstruction)
sc2generator = Sc2Generator(FluxSurface=fluxsurface, ShadingProjection=Slider(0, range=0..1), GlazingHeight=Slider(1, range=0..1))
deconstruct_fluxsurface_2 = DeconstructFluxSurface(FluxSurfaces=sc2generator)  # -> Text, Geometries, Areas, Orientations, FluxConstructions
deconstruct_fluxconstruction_3 = DeconstructFluxConstruction(FluxConstruction=deconstruct_fluxsurface_2.FluxConstructions)  # -> Summary, Uvalue, ScTotal, Materials
merge_4 = Merge(Data1=ettvsurfacecomponent, Data2=flatten(fluxsurface))
panel_6 = Panel(deconstruct_fluxconstruction_3.ScTotal)
fluxmodel = FluxModel(ProjectName="SchoolBuilding", Version="0", FluxSurfaces=merge_4, AngleToNorth="45")  # -> Status, FluxModel
deconstruct_ettvmodel = DeconstructEttvModel(EttvModel=fluxmodel.FluxModel)  # -> Text, ProjectName, Version, EttvSurfaces
computeretv = ComputeRetv(FluxModel=fluxmodel.FluxModel, RunComputation=boolean_toggle)  # -> Summary, RetvValue, RetvResult
computeettv = ComputeEttv(FluxModel=fluxmodel.FluxModel, RunComputation=boolean_toggle)  # -> Summary, EttvValue, EttvResult
display_flux_construction_type = DisplayFluxConstructionType(FluxModel=fluxmodel.FluxModel)  # -> Meshes, Legend
deconstruct_ettvsurface = DeconstructEttvSurface(EttvSurfaces=deconstruct_ettvmodel.EttvSurfaces)  # -> Text, Geometries, Areas, Orientations, EttvConstructions
exportettvhtml = ExportEttvHtml(Result=computeretv.RetvResult, RunExport=Toggle(True))  # -> HtmlPath, HtmlDocument
panel_7 = Panel(computeettv.Summary)
read_ettv_surface_result = ReadEttvSurfaceResult(EttvModelResult=computeettv.EttvResult)  # -> Surfaces, HeatGain
deconstruct_ettvconstruction = DeconstructEttvConstruction(EttvConstruction=deconstruct_ettvsurface.EttvConstructions)  # -> Summary, Uvalue, ScValue, Materials
panel_8 = Panel(display_flux_construction_type.Legend)
bounds = Bounds(Numbers=read_ettv_surface_result.HeatGain)
deconstruct_domain = DeconstructDomain(Domain=bounds)  # -> Start, End
create_set = CreateSet(List=deconstruct_ettvconstruction.Summary)  # -> Set, Map
panel_9 = Panel(create_set.Set)
gradient = Gradient(
    LowerLimit=deconstruct_domain.End,
    UpperLimit=deconstruct_domain.Start,
    Parameter=read_ettv_surface_result.HeatGain,
    stops=[0: RGB(234, 38, 0), 0.25: RGB(234, 126, 0), 0.5: RGB(254, 244, 84), 0.75: RGB(173, 203, 249), 1: RGB(75, 107, 169)])
custom_preview = CustomPreview(Geometry=read_ettv_surface_result.Surfaces, Material=gradient)
