# Grasshopper definition sample_test.gh (Grasshopper 1.0.8)
# plug-ins: BcaEttv Info

ettvmaterial = EttvMaterial(Name="Air", Conductivity="0.22", Thickness="3")
ettvmaterial_2 = EttvMaterial()
ettvmaterial_3 = EttvMaterial(Name="Concrete", Conductivity="1.5", Thickness="110")
ettvmaterial_4 = EttvMaterial()
ettvmaterial_5 = EttvMaterial(Name="Glass", Conductivity="0.8", Thickness="8")
ettvmaterial_6 = EttvMaterial()
panel = Panel(ettvmaterial_5)
merge = Merge(Data1=ettvmaterial_5, Data2=ettvmaterial, Data3=ettvmaterial_5)
merge_2 = Merge(Data1=ettvmaterial_4, Data2=ettvmaterial_2, Data3=ettvmaterial_6)
ettvopaqueconstruction = EttvOpaqueConstruction(Id="2", Name="Precast Concrete", Materials=ettvmaterial_3)
ettvfenestrationconstruction = EttvFenestrationConstruction(Id="1", Name="Double Glazing", Materials=merge, Sc="0.43")
deconstructettvconstruction = DeconstructEttvConstruction(EttvConstruction=ettvopaqueconstruction)  # -> Text, Uvalue, ScValue, Materials
deconstructettvconstruction_2 = DeconstructEttvConstruction(EttvConstruction=ettvfenestrationconstruction)  # -> Text, Uvalue, ScValue, Materials
panel_2 = Panel(deconstructettvconstruction.Text)
panel_3 = Panel(deconstructettvconstruction_2.Text)
brep = Brep(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)
brep_2 = Brep([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])
ettvsurfacecomponent = EttvSurfaceComponent(Geometry=brep, EttvConstruction=ettvfenestrationconstruction)
ettvsurfacecomponent_2 = EttvSurfaceComponent(Geometry=brep_2, EttvConstruction=ettvopaqueconstruction)
boolean_toggle = BooleanToggle(True)
merge_3 = Merge(Data1=ettvsurfacecomponent, Data2=ettvsurfacecomponent_2)
panel_4 = Panel(merge_3)
ettvmodel = EttvModel(EttvSurfaces=merge_3, Reorder=boolean_toggle, WriteEtvFile=boolean_toggle)  # -> Status, EttvModel, FilePath
deconstructettvsurface = DeconstructEttvSurface(EttvSurfaces=merge_3)  # -> Text, Geometries, Areas, Orientations, EttvConstructions
panel_5 = Panel(deconstructettvsurface.Text)
computeettv = ComputeEttv(EttvModel=ettvmodel.EttvModel, RunComputation=Toggle(False))  # -> EttvModel, EttvValue, Pass
panel_6 = Panel(ettvmodel.Status)
deconstructettvconstruction_3 = DeconstructEttvConstruction(EttvConstruction=deconstructettvsurface.EttvConstructions)  # -> Text, Uvalue, ScValue, Materials
bounds = Bounds(Numbers=deconstructettvconstruction_3.Uvalue)
geometry = Geometry(deconstructettvsurface.Geometries)
deconstruct_domain = DeconstructDomain(Domain=bounds)  # -> Start, End
gradient = Gradient(
    LowerLimit=deconstruct_domain.Start,
    UpperLimit=deconstruct_domain.End,
    Parameter=deconstructettvconstruction_3.Uvalue,
    stops=[0: RGB(234, 38, 0), 0.25: RGB(234, 126, 0), 0.5: RGB(254, 244, 84), 0.75: RGB(173, 203, 249), 1: RGB(75, 107, 169)])
custom_preview = CustomPreview(Geometry=geometry, Material=gradient)
